# Grasshopper definition cluster_github_test_v0.ghx (Grasshopper 0.9.14)

panel = Panel("""GUID###COLOR
GUID###COLOR""")
str = String()
str_2 = String(panel)
split = StringSplit(String=str_2, Separators="##I MOVED DID YOU MERGE ME RIGHT##")
dispatch = Dispatch(List=split, DispatchPattern=[True, False])  # -> flatten(ListA), flatten(ListB)
col = Colour(dispatch.ListB)
geo = Geometry(dispatch.ListB)
col_2 = Colour(col)
geo_2 = Geometry(geo)
